# Grasshopper definition singular_pattern_maker.ghx (Grasshopper 1.0.7)
# plug-ins: Weaverbird

# singular | compas_pattern
# Quad mesh densification and patterning
# Robin Oval
# rpho2@cam.ac.uk
# https://github.com/BlockResearchGroup/compas_pattern
mesh = Mesh(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)
tolerance_value = Slider(0.5, range=0..1)
# singular | compas_pattern
# Quad-mesh topological edit
# Robin Oval
# rpho2@cam.ac.uk
# https://github.com/BlockResearchGroup/compas_pattern
mesh_2 = Mesh(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)
fromrhinomesh = FromRhinoMesh(mesh_guid=mesh)  # -> mesh
# ---------- fromrhinomesh: Python ----------
from compas_pattern.rhino.grasshopper import gh_from_rhino_mesh
mesh = gh_from_rhino_mesh(mesh_guid)
# ---------- end fromrhinomesh ----------
# singular | compas_pattern
# Surface quad-meshing
# Robin Oval
# rpho2@cam.ac.uk
# https://github.com/BlockResearchGroup/compas_pattern
srf = Surface(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)

pt = Point([Point(4.67783024, 0.3459388189, 1.951780041), Point(3.176917069, 5.551557034, 3.253131615)])
crv = Curve()

fromrhinomesh_2 = FromRhinoMesh(mesh_guid=mesh_2)  # -> mesh; same code as fromrhinomesh
coarsen = CoarsenQuadMesh(quad_mesh=fromrhinomesh)  # -> coarse_quad_mesh
# ---------- coarsen: Python ----------
from compas_pattern.rhino.grasshopper import gh_coarsening
coarse_quad_mesh = gh_coarsening(quad_mesh)
# ---------- end coarsen ----------
srfquaddec = SurfaceQuadDecomposition(surface_guid=srf, accuracy_value=tolerance_value, point_guids=pt)  # -> quad_mesh; inputs point_guids: list, curve_guids: list
# ---------- srfquaddec: Python ----------
from compas_pattern.rhino.grasshopper import gh_surface_decomposition
quad_mesh = gh_surface_decomposition(surface_guid, accuracy_value, point_guids, curve_guids)
# ---------- end srfquaddec ----------
storestrips = StoreStrips(quad_mesh=fromrhinomesh_2)  # -> quad_mesh
# ---------- storestrips: Python ----------
from compas_pattern.rhino.grasshopper import gh_store_strips
quad_mesh = gh_store_strips(quad_mesh)
# ---------- end storestrips ----------
xy = XYPlane(Origin=Point(0, 0, 0))
data = Data(storestrips)
storestrips_2 = StoreStrips(quad_mesh=srfquaddec)  # -> quad_mesh; same code as storestrips
storestrips_3 = StoreStrips(quad_mesh=coarsen)  # -> quad_mesh; same code as storestrips
panel = Panel("4")
prot = RotatePlane(Plane=xy, Angle=degrees(Slider(45, range=0..100)))
rectangle = Rectangle(Plane=PlaneXY(0, 0, 0), XSize=Domain(-1, 1), YSize=Domain(-2, 2), Radius=0)  # -> Rectangle, Length
tolerance_value_2 = Slider(0.2, range=0..1)
vertices = MeshVertices(mesh=data)  # -> vertex_coordinates
# ---------- vertices: Python ----------
from compas_pattern.rhino.grasshopper import gh_vertices
vertex_coordinates = gh_vertices(mesh)
# ---------- end vertices ----------
strips = QuadMeshStrips(quad_mesh=data)  # -> strip_edges, strip_closed
# ---------- strips: Python ----------
from compas_pattern.rhino.grasshopper import gh_strips
strip_edges, strip_closed = gh_strips(quad_mesh)
# ---------- end strips ----------
wbedges = WeaverbirdsMeshEdges(MeshOrPolylines=mesh_2)
quad = MeshQuad(CornerA=0, CornerB=1, CornerC=2, CornerD=3)
triangle = MeshTriangle(CornerA=0, CornerB=1, CornerC=2)
polygon = Polygon(Plane=prot, Radius=3, Segments="3", FilletRadius=0)  # -> Polygon, Length
srf_2 = Surface(rectangle.Rectangle)
vertices_2 = MeshVertices(mesh=storestrips_2)  # -> vertex_coordinates; same code as vertices
strips_2 = QuadMeshStrips(quad_mesh=storestrips_2)  # -> strip_edges, strip_closed; same code as strips
line = Line(wbedges)
explode = Explode(Curve=polygon.Polygon, Recursive=True)  # -> Segments, reverse(Vertices)
boundary = BoundarySurfaces(Edges=polygon.Polygon)
vertices_3 = MeshVertices(mesh=storestrips_3)  # -> vertex_coordinates; same code as vertices
strips_3 = QuadMeshStrips(quad_mesh=storestrips_3)  # -> strip_edges, strip_closed; same code as strips
item = ListItem(List=vertices, Index=strips.strip_edges, Wrap=True)
srfquaddec_2 = SurfaceQuadDecomposition(surface_guid=boundary, accuracy_value=tolerance_value_2)  # -> quad_mesh; inputs point_guids: list, curve_guids: list; same code as srfquaddec
points = PointList(Points=vertices, Size=0.35)
cull_i = CullIndex(List=explode.Vertices, Indices="0", Wrap=True)
item_2 = ListItem(List=vertices_2, Index=strips_2.strip_edges, Wrap=True)
item_3 = ListItem(List=item, Index=0, Wrap=True)  # -> Item, Item1
conmesh = ConstructMesh(Vertices=cull_i, Faces=triangle)
conmesh_2 = ConstructMesh(Vertices=explode.Vertices, Faces=quad)
item_4 = ListItem(List=item_2, Index=0, Wrap=True)  # -> Item, Item1
ln = Line(StartPoint=item_3.Item, EndPoint=item_3.Item1)

panel_2 = Panel("""2
4
7""")
panel_3 = Panel("""15
14
13
17""")

torhinomesh = ToRhinoMesh(mesh=srfquaddec_2)  # -> mesh_guid
# ---------- torhinomesh: Python ----------
from compas_pattern.rhino.grasshopper import gh_to_rhino_mesh
mesh_guid = gh_to_rhino_mesh(mesh)
# ---------- end torhinomesh ----------
item_5 = ListItem(List=vertices_3, Index=strips_3.strip_edges, Wrap=True)
panel_4 = Panel("""3
8""")
panel_5 = Panel("""2
4
9
11
14
18""")
ln_2 = Line(StartPoint=item_4.Item, EndPoint=item_4.Item1)
mesh_3 = Mesh(torhinomesh)
trim = TrimTree(Tree=ln, Depth=1)
item_6 = ListItem(List=item_5, Index=0, Wrap=True)  # -> Item, Item1
trim_2 = TrimTree(Tree=ln_2, Depth=1)
entwine = Entwine(Branch00=panel_5, FlattenInputs=True)  # -> simplify(Result)
entwine_2 = Entwine(Branch00=panel_2, Branch01=panel_3, FlattenInputs=True)  # -> simplify(Result)
mesh_4 = Mesh(mesh_3)
curvepoint = PointOnCurve(trim, parameter=0.5)
ln_3 = Line(StartPoint=item_6.Item, EndPoint=item_6.Item1)
trim_3 = TrimTree(Tree=ln_3, Depth=1)
editstrip = EditQuadMeshStripTopology(mesh=storestrips, polyedges_to_add=entwine, strips_to_delete="2")  # -> mesh; inputs polyedges_to_add: tree of Int32, strips_to_delete: list of Int32
# ---------- editstrip: Python ----------
from compas_pattern.rhino.grasshopper import gh_add_delete_strips
mesh = gh_add_delete_strips(mesh, polyedges_to_add, strips_to_delete)
# ---------- end editstrip ----------
fromrhinomesh_3 = FromRhinoMesh(mesh_guid=mesh_4)  # -> mesh; same code as fromrhinomesh
editstrip_2 = EditQuadMeshStripTopology(mesh=storestrips, polyedges_to_add=entwine_2, strips_to_delete=panel_4)  # -> mesh; inputs polyedges_to_add: tree of Int32, strips_to_delete: list of Int32; same code as editstrip
len = Length(Curve=trim_2)
pline = PolyLine(Vertices=curvepoint, Closed=strips.strip_closed)  # -> flatten(Polyline)

target_length = Slider(1.2, range=0..2)
min_subdivision = Slider(1, range=0..10)

avr = Average(Input=len)
len_2 = Length(Curve=trim_3)
lng = ListLength(List=pline)
storestrips_4 = StoreStrips(quad_mesh=fromrhinomesh_3)  # -> quad_mesh; same code as storestrips
avr_2 = Average(Input=len_2)
division = Division(A=avr, B=Slider(0.4, range=0..2))

k = Slider(1, range=0..100)
d = Slider(0.2, range=0..1)

range = Range(Domain=Domain(0, 1), Steps=lng)
curvepoint_2 = PointOnCurve(pline, parameter=0.358)
max = Maximum(A=division, B=Slider(1, range=0..10))  # -> flatten(Result)
division_2 = Division(A=avr_2, B=target_length)
gradient = Gradient(
    LowerLimit=0,
    UpperLimit=1,
    Parameter=range,
    stops=[0: RGB(234, 38, 0), 0.25: RGB(234, 126, 0), 0.5: RGB(254, 244, 84), 0.75: RGB(173, 203, 249), 1: RGB(75, 107, 169)])
srf_3 = Surface(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)
srf_4 = Surface(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)
data_2 = Data(storestrips_4)
max_2 = Maximum(A=division_2, B=min_subdivision)  # -> flatten(Result)
int = Integer(max)
cstrsmoothing = ConstrainedLaplacianSmoothing(mesh=editstrip, k=k, d=d, surface_constraint=srf_3)  # -> smooth_mesh; inputs k: Int32, point_constraints: list
# ---------- cstrsmoothing: Python ----------
from compas_pattern.rhino.grasshopper import gh_constrained_smoothing
smooth_mesh = gh_constrained_smoothing(mesh, k=k, damping=d, surface_constraint=surface_constraint, point_constraints=point_constraints)
# ---------- end cstrsmoothing ----------
densify = DensifyQuadMesh(quad_mesh=storestrips_2, strips_subdivision=int)  # -> dense_quad_mesh; inputs strips_subdivision: list of Int32
# ---------- densify: Python ----------
from compas_pattern.rhino.grasshopper import gh_densifiying
dense_quad_mesh = gh_densifiying(quad_mesh, strips_subdivision)
# ---------- end densify ----------
data_3 = Data(data_2)
editstrip_3 = EditQuadMeshStripTopology(mesh=data_3, strips_to_delete="0")  # -> mesh; inputs polyedges_to_add: tree of Int32, strips_to_delete: list of Int32; same code as editstrip
densify_2 = DensifyQuadMesh(quad_mesh=storestrips_3, strips_subdivision=max_2)  # -> dense_quad_mesh; inputs strips_subdivision: list of Int32; same code as densify
preview = CustomPreview(Geometry=pline, Material=gradient)
points_2 = PointList(Points=curvepoint_2, Size=0.5)

k_2 = Slider(10, range=0..100)
d_2 = Slider(0.5, range=0..1)

vertices_4 = MeshVertices(mesh=data_3)  # -> vertex_coordinates; same code as vertices
strips_4 = QuadMeshStrips(quad_mesh=data_3)  # -> strip_edges, strip_closed; same code as strips
srf_5 = Surface(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)
data_4 = Data(cstrsmoothing)
data_5 = Data(data_4)
strips_5 = QuadMeshStrips(quad_mesh=data_5)  # -> strip_edges, strip_closed; same code as strips
trim_4 = TrimTree(Tree=strips_5.strip_edges, Depth=1)
tstat = TreeStatistics(Tree=trim_4)  # -> Paths, Length, Count

k_3 = Slider(20, range=0..100)
d_3 = Slider(0.5, range=0..1)

cstrsmoothing_2 = ConstrainedLaplacianSmoothing(mesh=densify_2, k=k_2, d=d_2, surface_constraint=srf_5)  # -> smooth_mesh; inputs k: Int32, point_constraints: list; same code as cstrsmoothing
dup = DuplicateData(Data=Slider(3, range=0..10), Number=tstat.Count, Order=True)
item_7 = ListItem(List=vertices_4, Index=strips_4.strip_edges, Wrap=True)
srf_6 = Surface(srf)
pt_2 = Point(pt)
points_3 = PointList(Points=vertices_4, Size=0.35)
num = Number(dup)
item_8 = ListItem(List=item_7, Index=0, Wrap=True)  # -> Item, Item1
data_6 = Data(data_4)
cstrsmoothing_3 = ConstrainedLaplacianSmoothing(mesh=densify, k=k_3, d=d_3, surface_constraint=srf_6, point_constraints=pt_2)  # -> smooth_mesh; inputs k: Int32, point_constraints: list; same code as cstrsmoothing
ln_4 = Line(StartPoint=item_8.Item, EndPoint=item_8.Item1)
list = ValueList({"seed", "dual", "join", "ambo", "kis", "needle", "zip", "truncate", "ortho", "expand", "gyro", "snub", "meta", "bevel"}, selected="gyro")
trim_5 = TrimTree(Tree=ln_4, Depth=1)
conway = ConwayOperator(mesh=cstrsmoothing_2, operator=list)  # -> polygonal_mesh
# ---------- conway: Python ----------
from compas_pattern.rhino.grasshopper import gh_conway
polygonal_mesh = gh_conway(mesh, operator)
# ---------- end conway ----------
densify_3 = DensifyQuadMesh(quad_mesh=data_6, strips_subdivision=num)  # -> dense_quad_mesh; inputs strips_subdivision: list of Int32; same code as densify

k_4 = Slider(5, range=0..100)
d_4 = Slider(0.5, range=0..1)

curvepoint_3 = PointOnCurve(trim_5, parameter=0.5)
torhinomesh_2 = ToRhinoMesh(mesh=cstrsmoothing_3)  # -> mesh_guid; same code as torhinomesh
pline_2 = PolyLine(Vertices=curvepoint_3, Closed=strips_4.strip_closed)  # -> flatten(Polyline)
X = UnitX(Factor=Slider(11, range=0..100))
mesh_5 = Mesh(torhinomesh_2)
data_7 = Data(densify_3)
data_8 = Data(data_7)
vertices_5 = MeshVertices(mesh=data_8)  # -> vertex_coordinates; same code as vertices
singularities = QuadMeshSingularities(quad_mesh=data_8)  # -> singularities
# ---------- singularities: Python ----------
from compas_pattern.rhino.grasshopper import gh_singularities
singularities = gh_singularities(quad_mesh)
# ---------- end singularities ----------
torhinomesh_3 = ToRhinoMesh(mesh=data_8)  # -> mesh_guid; same code as torhinomesh
item_9 = ListItem(List=vertices_5, Index=singularities, Wrap=True)
lng_2 = ListLength(List=pline_2)
move = Move(Geometry=torhinomesh_3, Motion=X)  # -> Geometry, Transform
cstrsmoothing_4 = ConstrainedLaplacianSmoothing(mesh=conway, k=k_4, d=d_4, surface_constraint=srf_5)  # -> smooth_mesh; inputs k: Int32, point_constraints: list; same code as cstrsmoothing
move_2 = Move(Geometry=item_9, Motion=X)  # -> Geometry, Transform
range_2 = Range(Domain=Domain(0, 1), Steps=lng_2)
curvepoint_4 = PointOnCurve(pline_2, parameter=0.358)
gradient_2 = Gradient(LowerLimit=0, UpperLimit=1, Parameter=range_2, stops=[0: RGB(0, 128, 0), 0.5: RGB(255, 255, 0), 1: RGB(255, 0, 0)])
circle = CircleCNR(Center=move_2.Geometry, Normal=Vector(0, 0, 1), Radius=Slider(0.1, range=0..1))
wbedges_2 = WeaverbirdsMeshEdges(MeshOrPolylines=move.Geometry)
torhinomesh_4 = ToRhinoMesh(mesh=conway)  # -> mesh_guid; same code as torhinomesh
data_9 = Data(conway)
boundary_2 = BoundarySurfaces(Edges=circle)
line_2 = Line(wbedges_2)
mesh_6 = Mesh(move.Geometry)
preview_2 = CustomPreview(Geometry=boundary_2, Material=ColourSwatch(SwatchColor=RGB(255, 0, 255)))
points_4 = PointList(Points=curvepoint_3, Size=0.5)
vertices_6 = MeshVertices(mesh=data_9)  # -> vertex_coordinates; same code as vertices
edges = MeshEdges(mesh=data_9)  # -> edge_vertices
# ---------- edges: Python ----------
from compas_pattern.rhino.grasshopper import gh_edges
edge_vertices = gh_edges(mesh)
# ---------- end edges ----------
preview_3 = CustomPreview(Geometry=pline_2, Material=gradient_2)
item_10 = ListItem(List=vertices_6, Index=edges, Wrap=True)
item_11 = ListItem(List=item_10, Index=0, Wrap=True)  # -> Item, Item1
ln_5 = Line(StartPoint=item_11.Item, EndPoint=item_11.Item1)
line_3 = Line(ln_5)

data_10 = Data(data_4)
vertices_7 = MeshVertices(mesh=data_10)  # -> vertex_coordinates; same code as vertices
strips_6 = QuadMeshStrips(quad_mesh=data_10)  # -> strip_edges, strip_closed; same code as strips
item_12 = ListItem(List=vertices_7, Index=strips_6.strip_edges, Wrap=True)
item_13 = ListItem(List=item_12, Index=0, Wrap=True)  # -> Item, Item1
ln_6 = Line(StartPoint=item_13.Item, EndPoint=item_13.Item1)
trim_6 = TrimTree(Tree=ln_6, Depth=1)
curvepoint_5 = PointOnCurve(trim_6, parameter=0.489)
pline_3 = PolyLine(Vertices=curvepoint_5, Closed=strips_6.strip_closed)  # -> flatten(Polyline)

move_3 = Move(Geometry=vertices_7, Motion=X)  # -> Geometry, Transform
move_4 = Move(Geometry=pline_3, Motion=X)  # -> Geometry, Transform

points_5 = PointList(Points=move_3.Geometry, Size=0.35)
curvepoint_6 = PointOnCurve(move_4.Geometry, parameter=0.271)
points_6 = PointList(Points=curvepoint_6, Size=0.5)

lng_3 = ListLength(List=move_4.Geometry)
subtraction = Subtraction(A=lng_3, B=1)
range_3 = Range(Domain=Domain(0, 1), Steps=subtraction)
gradient_3 = Gradient(
    LowerLimit=0,
    UpperLimit=1,
    Parameter=range_3,
    stops=[0: RGB(234, 38, 0), 0.25: RGB(234, 126, 0), 0.5: RGB(254, 244, 84), 0.75: RGB(173, 203, 249), 1: RGB(75, 107, 169)])
preview_4 = CustomPreview(Geometry=move_4.Geometry, Material=gradient_3)
